# Grasshopper definition torcSurface.gh (Grasshopper 0.9.76)
# plug-ins: MeshEdit Components, Kangaroo Components, gHowl, Firefly

# ---- group: manual rotation
panel = Panel("""0
120
135
45
30
210
0
120
330
240
90
255
0
135
90
345
30
60
0
210
150
300
30
90""")
num = Number(panel)

# ---- group: manual offset
panel_2 = Panel("""55
60
85
55
90
45
55
55
90
75
80
90
70
65
90
90
60
90
50
45
80
85
65
70""")
num_2 = Number(panel_2)

# ---- group: fin shape
crv = Curve(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)

# ----
toggle = BooleanToggle(True)
timer = Timer(TimerInterval=20, Target=read)
int = Integer(Slider(1, range=0..2))
ports_available = COMPortsAvailable()
read = SerialReadGeneric(StartReadingValues=toggle, PortNumber=ports_available)  # -> SerialOutput, StatusMessage
open_port = OpenClosePort(OpenClosePort=toggle, PortNumber=ports_available, BaudRate="9600")
write = SerialWriteGeneric(StartWritingValues=toggle, WriteData=int, PortNumber=ports_available)  # -> ArduinoOutput, StatusMessage

pt = Point(Point(2814.016719, -1493.330832, 1018.146906))
sph = Sphere(Base=pt, Radius=Slider(214, range=0..300))
preview = CustomPreview(Geometry=sph, Shader=ColourSwatch(SwatchColor=RGB(25, 255, 0)))

panel_3 = Panel(ports_available)
txt = Text(":")
split = TextSplit(Text=read.SerialOutput, Separators=txt)
panel_4 = Panel(split)
series = Series(Start=0, Step=1, Count=Slider(4, range=0..10))

# ----
# Instruction
# 
# 1. Set "Reset Physics" to True
# 
# 2. Set "Reset Physics" to False
# 
# 3. Set "OSC" to True (if you are using osc to get the datas)
timer_2 = Timer(TimerInterval=20, Target=[kangaroo, counter, read])  # disabled
surface_v = Slider(2, range=0..10)
axis_offset = Slider(75, range=0..100)
osc = BooleanToggle(True)
reset_physics = BooleanToggle(False)
fin_vertical_space = Slider(200, range=0..1000)
fin_number = Slider(6, range=0..10)
axis_number = Slider(4, range=0..10)
width = Slider(2870, range=0..10000)
height = Slider(2180, range=0..10000)
surface_u = Slider(5, range=0..10)
bbox = BoundingBox(Content=crv, Plane=PlaneXY(0, 0, 0))  # -> Box, Box_2
dim = Dimensions(Surface=bbox.Box)  # -> UDimension, VDimension
not = GateNot(A=reset_physics)
number_slider = Slider(3, range=0..3)  # disabled
number_slider_2 = Slider(9, range=0..10)  # disabled
number_slider_3 = Slider(5, range=0..10)  # disabled
number_slider_4 = Slider(7, range=0..10)  # disabled
udp = UDPReceiver(Address="127.0.0.1", Port="55000", Pattern="999")  # -> Info, Data
item = ListItem(List=split, Index=number_slider, Wrap=True)  # disabled
item_2 = ListItem(List=split, Index=number_slider_3, Wrap=True)  # disabled
item_3 = ListItem(List=split, Index=number_slider_4, Wrap=True)  # disabled
item_4 = ListItem(List=split, Index=number_slider_2, Wrap=True)  # disabled
merge = Merge(Data1=item, Data2=item_2, Data3=item_3, Data4=item_4)  # disabled
subset = SubList(List=split, Domain=Slider(3, range=0..10), Wrap=True)  # -> List, Index

num_3 = Number(2)
addition = Addition(A=axis_number, B=num_3)
num_4 = Number(1)
subtraction = Subtraction(A=addition, B=num_4)
division = Division(A=width, B=subtraction)
series_2 = Series(Start=0, Step=division, Count=addition)
pt_2 = ConstructPoint(XCoordinate=series_2, YCoordinate=0, ZCoordinate=0)
pt_3 = ConstructPoint(XCoordinate=series_2, YCoordinate=0, ZCoordinate=height)
merge_2 = Merge(Data1=simplify(graft(pt_2)), Data2=simplify(graft(pt_3)))
multiplication = Multiplication(A=subtraction, B=surface_u)
num_5 = Number(1)
pline = PolyLine(Vertices=merge_2, Closed=False)
subtraction_2 = Subtraction(A=multiplication, B=num_5)
num_6 = Number(1)
flatten = FlattenTree(Tree=pline, Path="{0}")
addition_2 = Addition(A=fin_number, B=num_6)
firstlastitem = FirstLastItem(list=flatten)  # -> first_item, rest_item, last_item
multiplication_2 = Multiplication(A=addition_2, B=surface_v)
divide = DivideCurve(Curve=firstlastitem.rest_item, Count=multiplication_2, Kinks=False)  # -> simplify(Points), Tangents, Parameters
divlength = DivideLength(Curve=firstlastitem.rest_item, Length=fin_vertical_space)  # -> simplify(Points), Tangents, Parameters

item_5 = ListItem(List=flatten(pline), Index=0, Wrap=True)
num_7 = Number(1)
end = EndPoints(Curve=item_5)  # -> Start, simplify(graft(End))
divlength_2 = DivideLength(Curve=item_5, Length=fin_vertical_space)  # -> simplify(Points), Tangents, Parameters
addition_3 = Addition(A=axis_number, B=num_7)
multiplication_3 = Multiplication(A=surface_u, B=addition_3)
merge_3 = Merge(Data1=divlength_2.Points, Data2=end.End)
range = Range(Domain=width, Steps=multiplication_3)
lng = ListLength(List=merge_3)
group = Group(Objects=merge_3)
X = UnitX(Factor=range)
move = Move(Geometry=group, Motion=X)  # -> Geometry, Transform
ungroup = Ungroup(Group=move.Geometry)  # -> simplify(flatten(Objects))
addition_4 = Addition(A=multiplication_3, B=num_7)

loft = Loft(Curves=flatten, Options={Adjust=False, Closed=False, LoftEnds=0, LoftSimp=0, LoftType=0, Rebuild=10, Refit=0.01})  # disabled
sdivide = DivideSurface(Surface=loft, UCount=multiplication, VCount=multiplication_2)  # -> simplify(Points), Normals, Parameters; disabled

c_script = CSharpScript(x=udp.Data)  # -> out, A; inputs x: list of String
# ---------- c_script: C# ----------
    List<int> intIndex = new List<int>();
    for(int i = 0; i < x.Count; i++){
      if(x[i][0] == '/'){
        intIndex.Add(i + 1);
      }
    }

    List<string> list = new List<string>();
    for(int i = 1; i < intIndex.Count; i++){
      int index = intIndex[i];
      list.Add(x[index]);
    }

    A = list;
# ---------- end c_script ----------
panel_5 = Panel(udp.Data)

# ---- group: position randam seed
panel_6 = Panel("""19529
10254
19912
7115""")

# ---- group: random position
firstlastitem_2 = FirstLastItem(list=divlength.Points)  # -> first_item, rest_item, last_item
flatten_2 = FlattenTree(Tree=ungroup, Path="{0}")
pt_4 = Point(firstlastitem_2.rest_item)
num_8 = Number(1)
graft = GraftTree(Tree=panel_6, IncludeEmptyLists=True, IncludeNullItems=True)
subtraction_3 = Subtraction(A=fin_number, B=num_8)
shufflelist = ShuffleListv2(x=pt_4, s=graft)  # -> out, list, key; inputs x: list, s: Int32
# ---------- shufflelist: C# ----------
    Random rng = new Random(s);
    List<int> intL = new List<int>();
    for(int i = 0; i < x.Count; i++){
      intL.Add(i);
    }
    int n = x.Count;
    while(n > 1){
      n--;
      int k = rng.Next(n + 1);
      Object value = x[k];
      x[k] = x[n];
      x[n] = value;
      
      int ivalue = intL[k];
      intL[k] = intL[n];
      intL[n] = ivalue;
    }

    list = x;
    key = intL;
# ---------- end shufflelist ----------
subset_2 = SubList(List=shufflelist.list, Domain=subtraction_3, Wrap=True)  # -> simplify(List), Index
crv_cp = CurveClosestPoint(Point=subset_2.List, Curve=reparameterize(simplify(graft(firstlastitem.rest_item))))  # -> Point, Parameter, Distance
sort = SortList(Keys=crv_cp.Parameter, ValuesA=subset_2.List)  # -> Keys, ValuesA
pt_5 = Point(flatten(sort.ValuesA))

# ----
viewer = ParamViewer(pt_4)  # disabled
number_slider_5 = Slider(20067, range=0..100000)  # disabled
number_slider_6 = Slider(4225, range=0..10000)  # disabled
lng_2 = ListLength(List=viewer)  # disabled
random = Random(Range=number_slider_5, Number=lng_2, Seed=number_slider_6)  # -> simplify(graft(Random)); disabled

cull_i = CullIndex(List=split, Indices=Slider(0, range=0..100), Wrap=True)
panel_7 = Panel(c_script.A)

# ---- group: offset
neg = Negative(Value=num_2)
move_2 = Move(Geometry=crv, Motion=pt_5)  # -> Geometry, Transform
Y = UnitY(Factor=neg)
move_3 = Move(Geometry=move_2.Geometry, Motion=Y)  # -> Geometry, Transform

# ----
dom = ConstructDomain(DomainStart=Slider(80, range=0..200), DomainEnd=Slider(140, range=0..1000))
lng_3 = ListLength(List=pt_5)
dom_2 = ConstructDomain(DomainStart=Slider(100, range=0..100), DomainEnd=Slider(150, range=0..1000))
random_2 = Random(Range=Slider(360, range=0..1000), Number=lng_3, Seed=2)
random_3 = Random(Range=dom_2, Number=lng_3, Seed=2)
random_4 = Random(Range=dom, Number=lng_3, Seed=2)

# ---- group: fin rotation
rad = Radians(Degrees=num)
rotate = Rotate(Geometry=move_3.Geometry, Angle=rad, Plane=pt_5)  # -> Geometry, Transform

# ----
a_rotation_adjustment = Slider(79, range=0..360)
b_rotation_adjustment = Slider(140, range=0..360)
c_rotation_adjustment = Slider(68, range=0..360)
d_rotation_adjustment = Slider(238, range=0..360)
merge_4 = Merge(Data1=a_rotation_adjustment, Data2=b_rotation_adjustment, Data3=c_rotation_adjustment, Data4=d_rotation_adjustment)  # -> graft(Result)

rad_2 = Radians(Degrees=merge_4)

# ---- group: random fin shape
cir = Circle(Plane=pt_5, Radius=random_3)
cp = ControlPoints(Curve=cir)  # -> simplify(Points), Weights, Knots
number_slider_7 = Slider(3, range=0..10)
duppt = RemoveDuplicatePts(Points=cp.Points, Tolerance=0.01)
shift = ShiftList(List=duppt, Shift=1, Wrap=True)  # -> simplify(List)
graft_2 = GraftTree(Tree=random_4, IncludeEmptyLists=True, IncludeNullItems=True)
split_2 = SplitList(List=shift, Index=number_slider_7)  # -> ListA, simplify(ListB)
subset_3 = SubList(List=shift, Domain=number_slider_7, Wrap=True)  # -> simplify(List), Index
Y_2 = UnitY(Factor=graft_2)  # -> simplify(UnitVector)
move_4 = Move(Geometry=split_2.ListA, Motion=Y_2)  # -> simplify(Geometry), Transform
item_6 = ListItem(List=move_4.Geometry, Index=Slider(1, range=0..1), Wrap=True)
scale = Scale(Geometry=move_4.Geometry, Center=item_6, Factor=Slider(0.6, range=0..1))  # -> Geometry, Transform
merge_5 = Merge(Data1=scale.Geometry, Data2=split_2.ListB)
nurbs = NurbsCurve(Vertices=merge_5, Degree=Slider(6, range=0..10), Periodic=True)  # -> flatten(Curve), Length, Domain

# ---- group: random rotation
panel_8 = Panel(random_2)

# ----
crv_cp_2 = CurveClosestPoint(Point=pt, Curve=firstlastitem.rest_item)  # -> Point, Parameter, Distance
number_slider_8 = Slider(5, range=0..10)
bnd = Bounds(Numbers=crv_cp_2.Distance)
dedomain = DeconstructDomain(Domain=bnd)  # -> Start, End
dom_3 = ConstructDomain(DomainStart=dedomain.Start, DomainEnd=Slider(2000, range=0..10000))
dom_4 = ConstructDomain(DomainStart=Slider(30, range=0..100), DomainEnd=number_slider_8)
remap = RemapNumbers(Value=crv_cp_2.Distance, Source=dom_3, Target=dom_4)  # -> Mapped, Clipped
counter = Counter(Reset=reset_physics)
max = Maximum(A=remap.Mapped, B=number_slider_8)
multiplication_4 = Multiplication(A=counter, B=max)  # -> simplify(graft(Result))
filter = StreamFilter(Gate=osc, Stream0=multiplication_4, Stream1=simplify(graft(cull_i)))
lng_4 = ListLength(List=sort.ValuesA)  # -> simplify(Length)
dup = DuplicateData(Data=filter, Number=lng_4, Order=True)  # -> simplify(Data)
flatten_3 = FlattenTree(Tree=dup, Path="{0}")

# ---- group: motor rotation
rad_3 = Radians(Degrees=flatten_3)
rotate_2 = Rotate(Geometry=rotate.Geometry, Angle=rad_3, Plane=pt_5)  # -> Geometry, Transform

# ---- group: rotate adjustment
unflatten = UnflattenTree(Tree=pt_5, Guide=sort.ValuesA)
unflatten_2 = UnflattenTree(Tree=rotate_2.Geometry, Guide=sort.ValuesA)
rotate_3 = Rotate(Geometry=unflatten_2, Angle=rad_2, Plane=unflatten)  # -> flatten(Geometry), Transform

# ---- group: axis offset
Y_3 = UnitY(Factor=axis_offset)
move_5 = Move(Geometry=firstlastitem.rest_item, Motion=Y_3)  # -> Geometry, Transform
move_6 = Move(Geometry=rotate_3.Geometry, Motion=Y_3)  # -> Geometry, Transform
crv_2 = Curve(move_6.Geometry)

# ----
pdecon = Deconstruct(Point=graft(pt_5))  # -> XComponent, YComponent, simplify(ZComponent)
pdecon_2 = Deconstruct(Point=flatten_2)  # -> XComponent, YComponent, ZComponent
pt_6 = ConstructPoint(XCoordinate=0, YCoordinate=0, ZCoordinate=pdecon_2.ZComponent)
pt_7 = ConstructPoint(XCoordinate=0, YCoordinate=0, ZCoordinate=pdecon.ZComponent)
dist = Distance(PointA=pt_6, PointB=pt_7)
dist_2 = Distance(PointA=graft(pt_5), PointB=flatten_2)
smaller = SmallerThan(FirstNumber=dist, SecondNumber=Slider(0.01, range=0..0.01))  # -> SmallerThan, OrEqualTo
smaller_2 = SmallerThan(FirstNumber=dist_2, SecondNumber=dim.UDimension)  # -> SmallerThan, OrEqualTo
and = GateAnd(A=smaller_2.SmallerThan, B=smaller.SmallerThan)
num_9 = Number(-1)
cull = CullPattern(List=flatten_2, CullPattern=and)  # -> simplify(List)
Y_4 = UnitY(Factor=num_9)
line = LineSDL(Start=cull, Direction=Y_4, Length=Slider(1000, range=0..1000))
graft_3 = GraftTree(Tree=crv_2, IncludeEmptyLists=True, IncludeNullItems=True)
ccx = CurveCurve(CurveA=graft_3, CurveB=line)  # -> simplify(Points), ParamsA, ParamsB
graft_4 = GraftTree(Tree=cull, IncludeEmptyLists=True, IncludeNullItems=True)
num_10 = Number(1)
prune = PruneTree(Tree=ccx.Points, Minimum=num_10, Maximum=0)
item_7 = ListItem(List=prune, Index=0, Wrap=True)
viewer_2 = ParamViewer(item_7)
split_3 = SplitTree(Data=graft_4, Masks=flatten(viewer_2))  # -> Positive, Negative
merge_6 = Merge(Data1=item_7, Data2=split_3.Negative)
dist_3 = Distance(PointA=graft_4, PointB=merge_6)
flatten_4 = FlattenTree(Tree=cull, Path="{0}")
flatten_5 = FlattenTree(Tree=dist_3, Path="{0}")
pow = Power(A=flatten_5, B=Slider(2, range=0..10))
bnd_2 = Bounds(Numbers=pow)
remap_2 = RemapNumbers(Value=pow, Source=bnd_2, Target=Slider(10000, range=0..18000))  # -> Mapped, Clipped
neg_2 = Negative(Value=remap_2.Mapped)
Y_5 = UnitY(Factor=neg_2)
uforce = UnaryForce(Point=flatten_4, Force=Y_5)

# ---- group: anchor
cp_2 = ClosestPoint(Point=pt_5, Cloud=flatten_2)  # -> ClosestPoint, CPIndex, Distance
item_8 = ListItem(List=flatten_2, Index=cp_2.CPIndex, Wrap=True)
num_11 = Number(-1)
Y_6 = UnitY(Factor=num_11)
line_2 = LineSDL(Start=item_8, Direction=Y_6, Length=1)
clx = CurveLine(Curve=crv_2, Line=line_2)  # -> simplify(Points), Params, Count
pdecon_3 = Deconstruct(Point=clx.Points)  # -> XComponent, YComponent, ZComponent
sort_2 = SortList(Keys=pdecon_3.YComponent, ValuesA=clx.Points)  # -> Keys, ValuesA
item_9 = ListItem(List=sort_2.ValuesA, Index=0, Wrap=True)  # -> flatten(Item)
filter_2 = StreamFilter(Gate=not, Stream0=item_8, Stream1=item_9)

# ----
num_12 = Number(1)
addition_5 = Addition(A=multiplication, B=num_12)
addition_6 = Addition(A=lng, B=num_12)  # disabled
frompoints = MeshFromPoints(Points=ungroup, UDirection=addition_4, VDirection=lng)
frompoints_2 = MeshFromPoints(Points=flatten_2, UDirection=addition_5, VDirection=addition_6)  # disabled
medges = MeshEdges(Mesh=frompoints)  # -> NakedEdges, InteriorEdges, NonManifoldEdges
springsfrommesh = SpringsFromMesh(M=frompoints, stiffness=1000, B=Slider(0.95, range=0..1))
crv_3 = Curve(medges.NakedEdges)
cp_3 = ControlPoints(Curve=crv_3)  # -> flatten(Points), Weights, Knots
duppt_2 = RemoveDuplicatePts(Points=cp_3.Points, Tolerance=0.01)
merge_7 = Merge(Data1=duppt_2, Data2=filter_2)  # -> flatten(Result)

merge_8 = Merge(Data1=springsfrommesh, Data2=uforce)  # -> flatten(Result)
kangaroo = KangarooPhysics(ForceObjects=merge_8, AnchorPoints=flatten(merge_7), Settings=null, Geometry=frompoints, SimulationReset=reset_physics)  # -> Out, Iterations, ParticlesOut, GeometryOut
geo = Geometry(kangaroo.GeometryOut)
demesh = DeconstructMesh(Mesh=geo)  # -> Vertices, Faces, Colours, Normals
pdecon_4 = Deconstruct(Point=demesh.Vertices)  # -> XComponent, YComponent, ZComponent
number_slider_9 = Slider(1, range=0..1)
bnd_3 = Bounds(Numbers=pdecon_4.YComponent)
remap_3 = RemapNumbers(Value=pdecon_4.YComponent, Source=bnd_3, Target=number_slider_9)  # -> Mapped, Clipped
subtraction_4 = Subtraction(A=number_slider_9, B=remap_3.Mapped)
multiplication_5 = Multiplication(A=remap_3.Mapped, B=Slider(0.5, range=0..1))
frgb = ColourRGBF(Alpha=1, Red=subtraction_4, Green=Slider(0, range=0..1), Blue=multiplication_5)
mcol = MeshColours(Mesh=geo, Colours=frgb)

swatch = ColourSwatch(SwatchColor=RGB(13, 235, 255))
boundary = BoundarySurfaces(Edges=crv_2)  # disabled
preview_2 = CustomPreview(Geometry=crv_2, Shader=swatch)
preview_3 = CustomPreview(Geometry=move_5.Geometry, Shader=swatch)

srfgrid = SurfaceFromPoints(Points=flatten_2, UCount=addition_5, Interpolate=False)  # -> reparameterize(Surface)
srf_cp = SurfaceClosestPoint(Point=flatten_2, Surface=srfgrid)  # -> Point, UVPoint, Distance

demesh_2 = DeconstructMesh(Mesh=mcol)  # -> Vertices, Faces, Colours, Normals
lng_5 = ListLength(List=demesh_2.Colours)
pdecon_5 = Deconstruct(Point=simplify(graft(demesh_2.Vertices)))  # -> XComponent, YComponent, ZComponent
pdecon_6 = Deconstruct(Point=simplify(graft(demesh_2.Normals)))  # -> XComponent, YComponent, ZComponent
deface = DeconstructFace(Face=simplify(graft(demesh_2.Faces)))  # -> CornerA, CornerB, CornerC, CornerD
lng_6 = ListLength(List=demesh_2.Faces)
dup_2 = DuplicateData(Data=Slider(1, range=0..1), Number=lng_5, Order=True)  # -> graft(Data)
merge_9 = Merge(Data1=pdecon_5.XComponent, Data2=pdecon_5.YComponent, Data3=pdecon_5.ZComponent)
merge_10 = Merge(Data1=pdecon_6.XComponent, Data2=pdecon_6.YComponent, Data3=pdecon_6.ZComponent)
merge_11 = Merge(Data1=deface.CornerA, Data2=deface.CornerB, Data3=deface.CornerC, Data4=deface.CornerD)
series_3 = Series(Start=0, Step=1, Count=lng_6)
dup_3 = DuplicateData(Data=dup_2, Number=Slider(4, range=0..10), Order=True)  # -> simplify(Data)
int_2 = Integer(simplify(graft(series_3)))
lng_7 = ListLength(List=merge_11)
num_13 = Number(1)
int_3 = Integer(num_13)
item_10 = ListItem(List=srf_cp.UVPoint, Index=merge_11, Wrap=True)  # -> flatten(Item)
lng_8 = ListLength(List=demesh_2.Vertices)
series_4 = Series(Start=0, Step=1, Count=lng_7)
num_14 = Number(1)
dup_4 = DuplicateData(Data=int_2, Number=lng_7, Order=True)  # -> flatten(Data)
c_script_2 = CSharpScript(x=merge_11, y=" ")  # -> out, A; inputs x: list
# ---------- c_script_2: C# ----------
    List<System.Object> list = new List<System.Object>();
    string s = "";
    for(int i = 0; i < x.Count; i++){
      s = s + x[i];
      if(i < x.Count - 1){
        s = s + y;
      }
    }
    A = s;
# ---------- end c_script_2 ----------
dup_5 = DuplicateData(Data=int_3, Number=lng_6, Order=True)  # -> simplify(graft(Data))
int_4 = Integer(flatten(series_4))
pdecon_7 = Deconstruct(Point=simplify(graft(item_10)))  # -> XComponent, YComponent, ZComponent
series_5 = Series(Start=0, Step=1, Count=lng_8)
dup_6 = DuplicateData(Data=num_14, Number=lng_8, Order=True)
graft_5 = GraftTree(Tree=simplify(int_4), IncludeEmptyLists=True, IncludeNullItems=True)  # -> simplify(Tree)
graft_6 = GraftTree(Tree=simplify(dup_4), IncludeEmptyLists=True, IncludeNullItems=True)  # -> simplify(Tree)
int_5 = Integer(simplify(graft(dup_6)))
int_6 = Integer(simplify(graft(series_5)))
merge_12 = Merge(Data1=int_6, Data2=merge_9, Data3=int_5, Data4=merge_10)
merge_13 = Merge(Data1=graft_6, Data2=graft_5, Data3=pdecon_7.XComponent, Data4=pdecon_7.YComponent, Data5=pdecon_7.ZComponent)
merge_14 = Merge(Data1=int_2, Data2=c_script_2.A, Data3=dup_5, Data4=dup_3)
c_script_3 = CSharpScript(x=merge_12, y="\t")  # -> out, flatten(A); inputs x: list; same code as c_script_2
c_script_4 = CSharpScript(x=merge_14, y="\t")  # -> out, flatten(A); inputs x: list; same code as c_script_2
c_script_5 = CSharpScript(x=merge_13, y="\t")  # -> out, flatten(A); inputs x: list; same code as c_script_2
merge_15 = Merge(Data1="index\tvertices\tclose\tCd(0)\tCd(1)\tCd(2)\tCd(3)", Data2=c_script_4.A)
merge_16 = Merge(Data1="index\tP(0)\tP(1)\tP(2)\tPw\tN(0)\tN(1)\tN(2)", Data2=c_script_3.A)
merge_17 = Merge(Data1="index\tvindex\tuv(0)\tuv(1)\tuv(2)", Data2=c_script_5.A)
panel_9 = Panel(merge_16)
panel_10 = Panel(merge_15)
panel_11 = Panel(merge_17)

# ==== cluster FirstLastItem
list = ClusterInput()
lng = ListLength(List=list)  # -> expr("x-1", Length)
cull_i = CullIndex(List=list, Indices=lng, Wrap=False)
item = ListItem(List=list, Index=lng, Wrap=False)  # -> simplify(Element)
item_2 = ListItem(List=list, Index=0, Wrap=False)  # -> simplify(Element)
cull_i_2 = CullIndex(List=cull_i, Indices=0, Wrap=False)  # -> simplify(List)
rest_item = ClusterOutput(cull_i_2)
last_item = ClusterOutput(item)
first_item = ClusterOutput(item_2)

# ==== cluster SpringsFromMesh: Turns all edges of a mesh into springs
M = ClusterInput()
medges = MeshEdges(Mesh=M)  # -> NakedEdges, InteriorEdges, NonManifoldEdges
crv = Curve([medges.NakedEdges, medges.InteriorEdges])
B = ClusterInput()
len = Length(Curve=crv)
multiplication = Multiplication(A=len, B=B)
stiffness = ClusterInput()
springs = SpringsFromLine(Connection=crv, Stiffness=stiffness, Damping=10, RestLength=multiplication, UpperCutoff=0, LowerCutoff=0, Plasticity=0)
S = ClusterOutput(springs)
